# Grasshopper definition GHL2.gh (Grasshopper 1.0.7)

number_slider = Slider(1.228, range=0..10)
rectangle = Rectangle(Plane=PlaneXY(0, 0, 0), XSize=Slider(5, range=0..10), YSize=Slider(5, range=0..10), Radius=Slider(0.5, range=0..10))  # -> Rectangle, Length
rectangle_2 = Rectangle(Plane=PlaneXY(0, 0, 0), XSize=Slider(2.5, range=0..10), YSize=Slider(2.5, range=0..10), Radius=Slider(0.5, range=0..10))  # -> Rectangle, Length
number_slider_2 = Slider(2.48, range=0..10)
unit_y = UnitY(Factor=number_slider)
unit_z = UnitZ(Factor=Slider(10, range=0..10))
unit_x = UnitX(Factor=number_slider)
number_slider_3 = Slider(2.5, range=0..10)
vector_xyz = VectorXYZ(XComponent=unit_x, YComponent=unit_y, ZComponent=unit_z)  # -> Vector, Length
unit_x_2 = UnitX(Factor=number_slider_2)
unit_z_2 = UnitZ(Factor=Slider(0.654, range=0..10))
unit_y_2 = UnitY(Factor=number_slider_2)
construct_point = ConstructPoint(XCoordinate=number_slider_3, YCoordinate=number_slider_3, ZCoordinate=0)
construct_point_2 = ConstructPoint(XCoordinate=number_slider_3, YCoordinate=number_slider_3, ZCoordinate=Slider(10, range=0..10))
circle = Circle(Plane=PlaneXY(0, 0, 0), Radius=Slider(1.5, range=0..10))
vector_xyz_2 = VectorXYZ(XComponent=unit_x_2, YComponent=unit_y_2, ZComponent=unit_z_2)  # -> Vector, Length
move = Move(Geometry=rectangle_2.Rectangle, Motion=vector_xyz.Vector)  # -> Geometry, Transform
line = Line(StartPoint=construct_point, EndPoint=construct_point_2)
move_2 = Move(Geometry=circle, Motion=vector_xyz_2.Vector)  # -> Geometry, Transform
loft = Loft(
    Curves=[rectangle.Rectangle, move.Geometry],
    Options={Adjust=False, Closed=False, LoftEnds=0, LoftSimp=0, LoftType=0, Rebuild=10, Refit=0.01})
unit_z_3 = UnitZ(Factor=Slider(10, range=0..10))
twist = Twist(Geometry=loft, Axis=line, Angle=Slider(2.269, range=0..10), Infinite=False, Rigid=False)
extrude = Extrude(Base=move_2.Geometry, Direction=unit_z_3)
number_slider_4 = Slider(2.5, range=-10..10)
brep = Brep(twist)
brep_2 = Brep(extrude)
number_slider_5 = Slider(10, range=0..10)
solid_difference = SolidDifference(BrepsA=brep, BrepsB=brep_2)
construct_point_3 = ConstructPoint(XCoordinate=number_slider_4, YCoordinate=number_slider_4, ZCoordinate=Slider(0, range=0..1))
xy_plane = XYPlane(Origin=construct_point_3)
number_slider_6 = Slider(23, range=0..25)
unit_z_4 = UnitZ(Factor=Slider(0.5, range=0..1))
linear_array = LinearArray(Geometry=xy_plane, Direction=unit_z_4, Count=number_slider_6)  # -> Geometry, Transform
series = Series(Start=0, Step=1, Count=number_slider_6)
brep_plane = BrepPlane(Brep=solid_difference, Plane=linear_array.Geometry)  # -> Curves, Points
curve = Curve(brep_plane.Curves)
unit_x_3 = UnitX(Factor=Slider(10, range=0..10))
move_3 = Move(Geometry=curve, Motion=unit_x_3)  # -> Geometry, Transform
move_to_plane = MoveToPlane(Geometry=move_3.Geometry, Plane=PlaneXY(0, 0, 0), Above=True, Below=True)  # -> Geometry, Transform
move_4 = Move(Geometry=move_to_plane.Geometry, Motion=unit_x_3)  # -> Geometry, Transform
