# Grasshopper definition GHL2NEW.gh (Grasshopper 1.0.7)

number_slider = Slider(0, range=0..10)
number_slider_2 = Slider(5, range=0..10)
number_slider_3 = Slider(0, range=0..10)
unit_x = UnitX(Factor=number_slider)
unit_y = UnitY(Factor=number_slider)
unit_z = UnitZ(Factor=Slider(10, range=0..10))
rectangle = Rectangle(Plane=PlaneXY(0, 0, 0), XSize=number_slider_2, YSize=number_slider_2, Radius=Slider(0, range=0..10))  # -> Rectangle, Length
rectangle_2 = Rectangle(Plane=PlaneXY(0, 0, 0), XSize=Slider(5, range=0..10), YSize=Slider(5, range=0..10), Radius=Slider(0, range=0..10))  # -> Rectangle, Length
rectangle_3 = Rectangle(Plane=PlaneXY(0, 0, 0), XSize=Slider(5, range=0..10), YSize=Slider(5, range=0..10), Radius=Slider(5, range=0..10))  # -> Rectangle, Length
unit_y_2 = UnitY(Factor=number_slider_3)
unit_z_2 = UnitZ(Factor=Slider(5, range=0..10))
unit_x_2 = UnitX(Factor=number_slider_3)
vector_xyz = VectorXYZ(XComponent=unit_x, YComponent=unit_y, ZComponent=unit_z)  # -> Vector, Length
number_slider_4 = Slider(2.5, range=0..10)
vector_xyz_2 = VectorXYZ(XComponent=unit_x_2, YComponent=unit_y_2, ZComponent=unit_z_2)  # -> Vector, Length
move = Move(Geometry=rectangle.Rectangle, Motion=vector_xyz.Vector)  # -> Geometry, Transform
construct_point = ConstructPoint(XCoordinate=number_slider_4, YCoordinate=number_slider_4, ZCoordinate=0)
construct_point_2 = ConstructPoint(XCoordinate=number_slider_4, YCoordinate=number_slider_4, ZCoordinate=Slider(10, range=0..10))
move_2 = Move(Geometry=rectangle_3.Rectangle, Motion=vector_xyz_2.Vector)  # -> Geometry, Transform
loft = Loft(
    Curves=[rectangle_2.Rectangle, move_2.Geometry, move.Geometry],
    Options={Adjust=False, Closed=False, LoftEnds=0, LoftSimp=0, LoftType=0, Rebuild=10, Refit=0.01})
line = Line(StartPoint=construct_point, EndPoint=construct_point_2)
twist = Twist(Geometry=loft, Axis=line, Angle=Slider(2.269, range=0..10), Infinite=False, Rigid=False)
number_slider_5 = Slider(-0.835, range=-10..10)
number_slider_6 = Slider(6.662, range=0..10)
construct_point_3 = ConstructPoint(XCoordinate=number_slider_6, YCoordinate=number_slider_6, ZCoordinate=number_slider_5)
construct_point_4 = ConstructPoint(XCoordinate=number_slider_5, YCoordinate=number_slider_5, ZCoordinate=number_slider_5)
xy_plane = XYPlane(Origin=Point(0, 0, 0))
number_slider_7 = Slider(0.5, range=0..1)
rectangle_2pt = Rectangle2Pt(Plane=xy_plane, PointA=construct_point_3, PointB=construct_point_4, Radius=0)  # -> Rectangle, Length
unit_z_3 = UnitZ(Factor=number_slider_7)
extrude = Extrude(Base=rectangle_2pt.Rectangle, Direction=unit_z_3)
number_slider_8 = Slider(23, range=0..25)
cap_holes = CapHoles(Brep=extrude)
linear_array = LinearArray(Geometry=cap_holes, Direction=unit_z_3, Count=number_slider_8)  # -> Geometry, Transform
number_slider_9 = Slider(165, range=0..1000)
xy_plane_2 = XYPlane(Origin=Point(0, 0, 0))
brep = Brep(twist)
rectangle_4 = Rectangle(Plane=xy_plane_2, XSize=number_slider_9, YSize=number_slider_9, Radius=0)  # -> Rectangle, Length
expression = Expression(N=number_slider_8, Expression="N+1")
contour = Contour(Shape=brep, Point=Point(0, 0, 0), Direction=Vector(0, 0, 1), Distance=number_slider_7)
divide_surface = DivideSurface(Surface=rectangle_4.Rectangle, UCount=number_slider_8, VCount=Slider(1, range=0..10))  # -> Points, Normals, Parameters
series = Series(Start=1, Step=1, Count=expression)
move_3 = Move(Geometry=contour, Motion=divide_surface.Points)  # -> Geometry, Transform
panel = Panel(series)
move_to_plane = MoveToPlane(Geometry=move_3.Geometry, Plane=PlaneXY(0, 0, 0), Above=True, Below=True)  # -> Geometry, Transform
boundary_surfaces = BoundarySurfaces(Edges=move_to_plane.Geometry)
area = Area(Geometry=boundary_surfaces)  # -> Area, Centroid
line_2 = Line(Line((-6.25, 1, 0), (171.5, 2.5, 0)))
text_on_surface = TextOnSurface(Text=panel, Font="Sans Bold:no Italic:no", Height=1, Depth=0.4, BaseLine=line_2, BaseSurface=boundary_surfaces)
move_4 = Move(Geometry=text_on_surface, Motion=area.Centroid)  # -> Geometry, Transform
text_tag = TextTag(Location=area.Centroid, Text=panel, Colour=ColourSwatch(SwatchColor=RGB(0, 0, 0)))
